# Grasshopper definition FloorPlanGenerator_Combined.gh (Grasshopper 1.0.7)
# plug-ins: Wombat, treesloth01, eleFront

path = FilePath("C:\Users\REN\Downloads\dataObject.json")  # disabled
data = Data("C:\Users\REN\Downloads\dataObject.json")
file = ReadFile(File=data, PerLineParse=True)
_7000 = Data(Tree({0}: [16.77192857, 4.946428571, 2.930428571, 8.329285714], {1}: [24.49778571, 2.757857143, 3.071285714, 6.752142857], {2}: [21.2115, 1.683571429, 2.799571429, 9.357857143], {3}: [11.58021429, 8.429285714, 3.707285714, 7.795], {4}: [22.57307143, 2.766428571, 2.816428571, 3.789285714], {5}: [16.5945, 0.02642857143, 3.068714286, 8.442142857]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))
integer = Integer(_7000)
python = GhPythonScript(x=data)  # -> out, lineType, vertices, corridor, levels
# ---------- python: Python ----------
__author__ = "REN"
__version__ = "2023.08.24"

import rhinoscriptsyntax as rs
import json

with open(x, 'r') as file:
    data = json.load(file)
print(data)

#print(data["geometry"]["type"])
#print(data["geometry"]["coordinates"])
#print(data["properties"]["corridorType"])
#print(data["properties"]["floorsInput"])

lineType = data["geometry"]["type"]
vertices = data["geometry"]["coordinates"]
corridor = data["properties"]["corridorType"]
levels = data["properties"]["floorsInput"]
# ---------- end python ----------
panel = Panel(python.lineType)
branch = TreeBranch(Tree=integer, Path=Slider(674, range=0..1000), MaintainPaths=True)
c_script = CSharpScript(x=python.vertices)  # -> out, A
# ---------- c_script: C# ----------
    A = x;
# ---------- end c_script ----------
panel_2 = Panel(branch)
explode_tree = ExplodeTree(Data=graft(branch))  # -> Branch0, Branch1, Branch2, Branch3
panel_3 = Panel(file)
# 31.8
number_slider = Slider(31.8, range=25..50)
find_assemblies = GhPythonScript()  # -> out
# ---------- find_assemblies: Python ----------
import Grasshopper as gh

this = ghenv.Component
thisDoc = this.OnPingDocument()

asms = []

for obj in thisDoc.Objects:
    #print obj.GetType().BaseType
    
    #if obj.Obsolete: print 'Warning: Obsolete'
    #print 'Name: {}\nDescription: {}\nCategory: {} -> {}\n '.format(obj.Name, obj.Description, obj.Category, obj.SubCategory)
    #print 'Pivot: {} \t Bounds: {}'.format(obj.Attributes.Pivot, obj.Attributes.Bounds)
    
    asm = gh.Instances.ComponentServer.FindAssemblyByObject(obj.ComponentGuid)
    
    #print(x.IsCoreLibrary)
    if asm is not None and not asm.IsCoreLibrary:
        asms.append(asm.Name)
    
print asms
# ---------- end find_assemblies ----------

# ----
# Create Large Rectangle and Populate it with loads of points
number_slider_2 = Slider(54.9, range=0..100)
number_slider_3 = Slider(82.3, range=0..100)
neg = Negative(Value=number_slider_2)
neg_2 = Negative(Value=number_slider_3)
concat = Concatenate(FragmentA=neg, FragmentB=number_slider_2, JoinSeparator=" to ")
concat_2 = Concatenate(FragmentA=neg_2, FragmentB=number_slider_3, JoinSeparator=" to ")
rectangle = Rectangle(Plane=PlaneXY(0, 0, 0), XSize=concat, YSize=concat_2, Radius=0)  # -> Rectangle, Length
pop2d = Populate2D(Region=rectangle.Rectangle, Count=explode_tree.Branch1, Seed=explode_tree.Branch0)

panel_4 = Panel(find_assemblies)
levels = GetInteger(python.levels, AtLeast=1, AtMost=1, Maximum=2147483647, Minimum=-2147483648, TreeAccess=False)
data_2 = Data(c_script.A)
subtraction = Subtraction(A=explode_tree.Branch1, B=explode_tree.Branch2)
vertices = GetNumber(data_2, AtLeast=1, AtMost=1, Maximum=1.797693135e+308, Minimum=-1.797693135e+308, TreeAccess=False)
int = Integer(levels)

# ----
# Random Reduce and Create Polyline
reduce = RandomReduce(List=pop2d, Reduction=subtraction, Seed=1)
pdecon = Deconstruct(Point=reduce)  # -> XComponent, YComponent, ZComponent
sort = SortList(Keys=pdecon.XComponent, ValuesA=reduce)  # -> Keys, ValuesA
pline = PolyLine(Vertices=sort.ValuesA, Closed=False)

panel_5 = Panel(data_2)
flip = FlipMatrix(Data=vertices)
subtraction_2 = Subtraction(A=int, B="1")
panel_6 = Panel(flip)
bang = ExplodeTree(Data=flip)  # -> Branch0, Branch1
pt = ConstructPoint(XCoordinate=bang.Branch0, YCoordinate=bang.Branch1, ZCoordinate=0)
linetype = GetString(python.lineType, AtLeast=1, AtMost=1, TreeAccess=False)
round = Round(Number=number_slider)  # -> Nearest, Floor, Ceiling

# ----
# Explode Polyline and measure angle,
# if greater than 100° don't send it, if less
# pass it thru
explode = Explode(Curve=pline, Recursive=True)  # -> Segments, Vertices
bang_2 = ExplodeTree(Data=simplify(graft(explode.Segments)))  # -> Branch0, Branch1
angle = Angle(VectorA=bang_2.Branch0, VectorB=bang_2.Branch1)  # -> Angle, Reflex
deg = Degrees(Radians=angle.Angle)
smaller = SmallerThan(FirstNumber=deg, SecondNumber="100")  # -> SmallerThan, OrEqualTo
filter = StreamFilter(Gate=smaller.SmallerThan, Stream1=pline)  # disabled

points = PointList(Points=pt, Size=Slider(53, range=0..100))
txt = Text(linetype)

# ----
# Half of Building Width (m)
number_slider_4 = Slider(12.5, range=0..100)
neg_3 = Negative(Value=number_slider_4)
merge = Merge(Data1=number_slider_4, Data2=neg_3)

# ----
# Half of Corridor Width (m)
number_slider_5 = Slider(1, range=0..100)
neg_4 = Negative(Value=number_slider_5)
merge_2 = Merge(Data1=number_slider_5, Data2=neg_4)

# ----
# Half of Building Width (m)
number_slider_6 = Slider(12.5, range=0..100)
neg_5 = Negative(Value=number_slider_6)
merge_3 = Merge(Data1=neg_4, Data2=neg_5)

# ----
# Single or Double Loaded Parameter
list = ValueList({"Double Loaded": 0, "Single Loaded": 1}, selected="Double Loaded")
corridor = GetString("double loaded", AtLeast=1, AtMost=1, TreeAccess=False)

division = Division(A=round.Nearest, B="2")

# ----
# Polygon or LineString
# Sets Closed or Open Polyline (Pull Geometry Type from JSON)
panel_7 = Panel("""Polygon
LineString""")
list_2 = ValueList({"Polygon": 0, "LineString": 1}, selected="LineString")
bang_3 = ExplodeTree(Data=graft(panel_7))  # -> Branch0, Branch1
filter_2 = StreamFilter(Gate=list_2, Stream0=bang_3.Branch0, Stream1=bang_3.Branch1)
tmatch = MatchText(Text=txt, RegEx="Polygon", Case=True)
filter_3 = StreamFilter(Gate=tmatch, Stream0=Toggle(False), Stream1=Toggle(True))
filter_4 = StreamFilter(Gate=tmatch, Stream0=Slider(5, range=0..10), Stream1=division)
pline_2 = PolyLine(Vertices=flatten(pt), Closed=filter_3)

tmatch_2 = MatchText(Text=corridor, RegEx="single loaded", Case=True)
int_2 = Integer(tmatch_2)
filter_5 = StreamFilter(Gate=int_2, Stream0=merge, Stream1=merge_3)

# ----
# Create Corridor Boundary
offset = OffsetCurve(Curve=pline_2, Distance=merge_2, Corners=1)  # -> simplify(Curve)
end = EndPoints(Curve=offset)  # -> Start, End
bang_4 = ExplodeTree(Data=offset)  # -> Branch0, Branch1
bang_5 = ExplodeTree(Data=end.Start)  # -> Branch0, Branch1
bang_6 = ExplodeTree(Data=end.End)  # -> Branch0, Branch1
ln = Line(StartPoint=bang_5.Branch0, EndPoint=bang_5.Branch1)
ln_2 = Line(StartPoint=bang_6.Branch0, EndPoint=bang_6.Branch1)
merge_4 = Merge(Data1=bang_4.Branch0, Data2=ln, Data3=bang_4.Branch1, Data4=ln_2)  # -> flatten(Result)

# ----
# Create Building Boundary
offset_2 = OffsetCurve(Curve=pline_2, Distance=filter_5, Corners=1)  # -> simplify(Curve)
end_2 = EndPoints(Curve=offset_2)  # -> Start, End
bang_7 = ExplodeTree(Data=offset_2)  # -> Branch0, Branch1
bang_8 = ExplodeTree(Data=end_2.Start)  # -> Branch0, Branch1
bang_9 = ExplodeTree(Data=end_2.End)  # -> Branch0, Branch1
ln_3 = Line(StartPoint=bang_8.Branch0, EndPoint=bang_8.Branch1)
ln_4 = Line(StartPoint=bang_9.Branch0, EndPoint=bang_9.Branch1)
merge_5 = Merge(Data1=bang_7.Branch0, Data2=ln_3, Data3=bang_7.Branch1, Data4=ln_4)  # -> flatten(Result)
join = JoinCurves(Curves=merge_5, Preserve=False)

# ----
# Create Corridor Boundary
offset_3 = OffsetCurve(Curve=pline_2, Distance=merge_2, Corners=1)  # -> simplify(Curve)
filter_6 = StreamFilter(Gate=tmatch, Stream0=merge_4, Stream1=offset_3)
join_2 = JoinCurves(Curves=filter_6, Preserve=False)

# ---- group: Corridor Curves
crv = Curve(flatten(offset_3))

# ----
len = Length(Curve=crv)

# ---- group: Corridor Centerline
crv_2 = Curve(pline_2)

# ----
len_2 = Length(Curve=crv_2)
division_2 = Division(A=len_2, B="120")
round_2 = Round(Number=division_2)  # -> Nearest, Floor, Ceiling
divide = DivideCurve(Curve=crv_2, Count=round_2.Ceiling, Kinks=False)  # -> Points, Tangents, Parameters

number_slider_7 = Slider(4, range=0..10)
series = Series(Start=number_slider_7, Step=number_slider_7, Count=subtraction_2)  # -> flatten(Series)
unit_z = UnitZ(Factor=series)  # -> simplify(graft(UnitVector))
negative = Negative(Value=number_slider_7)

# ----
# Corridor Wall
# Centerlines
crv_3 = Curve(crv)

path_2 = FilePath("C:\Users\REN\Documents\MaCAD\Thesis\JSON-Output.json")

# ----
# Create Building Boundary
offset_4 = OffsetCurve(Curve=pline_2, Distance=filter_5, Corners=1)  # -> simplify(Curve)

filter_7 = StreamFilter(Gate=tmatch, Stream0=merge_5, Stream1=offset_4)

join_3 = JoinCurves(Curves=filter_7, Preserve=False)

# ---- group: Boundary
crv_4 = Curve(join_3)

# ----
# Corridor and Building Boundaries
crv_5 = Curve(pline_2)
explode_2 = Explode(Curve=crv_5, Recursive=True)  # -> Segments, Vertices
boundary_surfaces = BoundarySurfaces(Edges=flatten(crv_4))

# ----
# Divide Curve, Drop First and Last
number_slider_8 = Slider(5, range=0..10)
divdist = DivideDistance(Curve=crv_5, Distance=number_slider_8)  # -> Points, Tangents, Parameters
cull_i = CullIndex(List=divdist.Points, Indices="0", Wrap=True)

# ----
# Loft Corridor Curves and
# Trim / Split Demising Curves
# Random Reduce Demsing to
# Make Larger Rooms
Z = UnitZ(Factor=1)
move = Move(Geometry=join_2, Motion=Z)  # -> Geometry, Transform
loft = Loft(
    Curves=[join_2, move.Geometry],
    Options={Adjust=False, Closed=False, LoftEnds=0, LoftSimp=0, LoftType=0, Rebuild=10, Refit=0.01})
pull = PullPoint(Point=cull_i, Geometry=offset_4, ClosestOnly=True)  # -> ClosestPoint, Distance
ln_5 = Line(StartPoint=cull_i, EndPoint=pull.ClosestPoint)
split = SplitWithBrep(Curve=simplify(ln_5), Brep=loft)  # -> Curve, Points
item = ListItem(List=split.Curve, Index=Slider(1, range=0..1), Wrap=True)
reduce_2 = RandomReduce(List=flatten(item), Reduction=filter_4, Seed=1)

# ----
# Clean Up Corners
end_3 = EndPoints(Curve=reduce_2)  # -> Start, End
cullpt = CullDuplicates(Points=end_3.End, Tolerance=0.1, CullMode=3)  # -> Points, Indices, Valence
item_2 = ListItem(List=reduce_2, Index=cullpt.Indices, Wrap=True)

# ---- group: Demising
crv_6 = Curve(item_2)

# ----
# Sort out Corridor
merge_6 = Merge(Data1=crv_6, Data2=crv)  # -> flatten(Result)
srf = Surface(boundary_surfaces)
midpt = CurveMiddle(Curve=pline_2)
srfsplit = SurfaceSplit(Surface=srf, Curves=merge_6)
srf_cp = SurfaceClosestPoint(Point=midpt, Surface=srfsplit)  # -> Point, UVPoint, Distance
smaller_2 = SmallerThan(FirstNumber=srf_cp.Distance, SecondNumber="1e-5")  # -> SmallerThan, OrEqualTo
dispatch = Dispatch(List=srfsplit, DispatchPattern=smaller_2.SmallerThan)  # -> ListA, ListB

len_3 = Length(Curve=flatten(crv_4))
crossref = CrossReference(ListA=len, ListB=len_3, CrossMode=1)  # -> ListA, ListB
equals = Equality(FirstNumber=crossref.ListA, SecondNumber=crossref.ListB)  # -> Equality, Inequality
dispatch_2 = Dispatch(List=crossref.ListA, DispatchPattern=equals.Equality)  # -> ListA, ListB
equals_2 = Equality(FirstNumber=len, SecondNumber=dispatch_2.ListA)  # -> Equality, Inequality
dispatch_3 = Dispatch(List=len, DispatchPattern=equals_2.Equality)  # -> ListA, ListB
equals_3 = Equality(FirstNumber=len_3, SecondNumber=dispatch_3.ListA)  # -> Equality, Inequality
dispatch_4 = Dispatch(List=flatten(crv_4), DispatchPattern=equals_3.Equality)  # -> ListA, ListB

# ----
# Outer Wall
# Boundary
# Double Loaded
crv_7 = Curve(flatten(crv_4))

# ----
# Outer Wall
# Boundary
# Single Loaded
crv_8 = Curve(dispatch_4.ListB)

filter_8 = StreamFilter(Gate=int_2, Stream0=crv_7, Stream1=crv_8)

# ----
# Outer Wall
# Boundary
crv_9 = Curve(filter_8)

# ----
# Demising
crv_10 = Curve(crv_6)

# ----
# Sort Surfaces Along Corridor Center Curve
area = Area(Geometry=dispatch.ListB)  # -> Area, Centroid
pull_2 = PullPoint(Point=area.Centroid, Geometry=pline_2, ClosestOnly=True)  # -> ClosestPoint, Distance

# ---- group: Cooridor Nodes
alongcrv = SortAlongCurve(Points=pull_2.ClosestPoint, Curve=pline_2)  # -> Points, Indices

# ----
mindex = MemberIndex(Set=pull_2.ClosestPoint, Member=alongcrv.Points)  # -> Index, Count
cset = CreateSet(List=flatten(mindex.Index))  # -> Set, Map
item_3 = ListItem(List=dispatch.ListB, Index=cset.Set, Wrap=True)

# ---- group: Corridor edges
explode_3 = Explode(Curve=crv_2, Recursive=True)  # -> Segments, Vertices
cull_duplicates = CullDuplicates(Points=alongcrv.Points, Tolerance=0.1, CullMode=3)  # -> Points, Indices, Valence
point = Point([explode_3.Vertices, cull_duplicates.Points])
curve_closest_point = CurveClosestPoint(Point=flatten(point), Curve=crv_2)  # -> Point, Parameter, Distance
shatter = Shatter(Curve=crv_2, Parameters=curve_closest_point.Parameter)
end_points = EndPoints(Curve=shatter)  # -> Start, End
point_2 = Point([end_points.Start, end_points.End])
cull_duplicates_2 = CullDuplicates(Points=alongcrv.Points, Tolerance=0.1, CullMode=3)  # -> flatten(Points), Indices, Valence
cull_duplicates_3 = CullDuplicates(Points=point_2, Tolerance=0.1, CullMode=3)  # -> Points, Indices, Valence

# ----
filter_9 = StreamFilter(Gate=int_2, Stream0=cull_duplicates_2.Points, Stream1=cull_duplicates_3.Points)

# ----
# Get Only The Typical Sized Spaces,
# Not Small, Not Large, Egress Should
# Only Be In Typical Locations
# Find Room Closest to Egress Points
geo = Geometry(item_3)
area_2 = Area(Geometry=geo)  # -> Area, Centroid
cset_2 = CreateSet(List=area_2.Area)  # -> Set, Map
mindex_2 = MemberIndex(Set=area_2.Area, Member=cset_2.Set)  # -> Index, Count
lng = ListLength(List=mindex_2.Index)
bnd = Bounds(Numbers=flatten(lng))
dedomain = DeconstructDomain(Domain=bnd)  # -> Start, End
equals_4 = Equality(FirstNumber=lng, SecondNumber=dedomain.End)  # -> Equality, Inequality
dispatch_5 = Dispatch(List=cset_2.Set, DispatchPattern=flatten(equals_4.Equality))  # -> ListA, ListB
mindex_3 = MemberIndex(Set=area_2.Area, Member=dispatch_5.ListA)  # -> Index, Count
lng_2 = ListLength(List=geo)
item_4 = ListItem(List=geo, Index=mindex_3.Index, Wrap=True)
area_3 = Area(Geometry=item_4)  # -> Area, Centroid
series_2 = Series(Start=0, Step=1, Count=lng_2)
dist = Distance(PointA=area_3.Centroid, PointB=graft(divide.Points))
sort_2 = SortList(Keys=dist, ValuesA=mindex_3.Index)  # -> Keys, ValuesA
item_5 = ListItem(List=sort_2.ValuesA, Index=0, Wrap=True)  # -> flatten(Item)
sort_3 = SortList(Keys=item_5)  # -> Keys, ValuesA
sort_4 = SortList(Keys=dist, ValuesA=item_4)  # -> Keys, ValuesA
difference = SetDifference(SetA=series_2, SetB=sort_3.Keys)
item_6 = ListItem(List=geo, Index=difference, Wrap=True)

data_3 = Data(flatten(filter_9))

# ---- group: Corridor edges
# Corridor Edges
shift_list = ShiftList(List=data_3, Shift=1, Wrap=True)
cull_index = CullIndex(List=shift_list, Indices="-1", Wrap=True)
dispatch_6 = Dispatch(List=cull_index, DispatchPattern=[True, False])  # -> ListA, ListB
dispatch_7 = Dispatch(List=data_3, DispatchPattern=[True, False])  # -> ListA, ListB
point_3 = Point(dispatch_7.ListA)
point_4 = Point(dispatch_7.ListB)
point_5 = Point(dispatch_6.ListA)
point_6 = Point(dispatch_6.ListB)
line = Line(StartPoint=point_3, EndPoint=point_4)
line_2 = Line(StartPoint=point_5, EndPoint=point_6)
weave = Weave(Pattern=[0, 1], Stream0=line, Stream1=line_2, NullGaps=False)

# ---- group: Egress
item_7 = ListItem(List=sort_4.ValuesA, Index=0, Wrap=True)  # -> flatten(Item)

# ---- group: Egress Nodes
area_4 = Area(Geometry=item_7)  # -> Area, Centroid

# ----
area_5 = Area(Geometry=item_6)  # -> Area, Centroid

cset_3 = CreateSet(List=area_5.Centroid)  # -> Set, Map
mindex_4 = MemberIndex(Set=cset_3.Set, Member=area_4.Centroid)  # -> Index, Count
cull_i_2 = CullIndex(List=cset_3.Set, Indices=flatten(mindex_4.Index), Wrap=True)

cp = ClosestPoint(Point=cull_i_2, Cloud=alongcrv.Points)  # -> ClosestPoint, CPIndex, Distance

# ---- group: Rooms Egdes
line_3 = Line(StartPoint=cull_i_2, EndPoint=cp.ClosestPoint)

# ----
data_4 = Data(flatten(line_3))

cp_2 = ClosestPoint(Point=area_4.Centroid, Cloud=flatten(data_3))  # -> ClosestPoint, CPIndex, Distance
pt_2 = Point(area_4.Centroid)
pt_3 = Point(cp_2.ClosestPoint)
line_4 = Line(StartPoint=area_4.Centroid, EndPoint=cp_2.ClosestPoint)
point_list = PointList(Points=pt_3)
move_2 = Move(Geometry=flatten(pt_2), Motion=unit_z)  # -> Geometry, Transform
move_3 = Move(Geometry=flatten(line_4), Motion=unit_z)  # -> Geometry, Transform
merge_7 = Merge(Data1=flatten(pt_2), Data2=flatten(move_2.Geometry))
lng_3 = ListLength(List=pt_2)
merge_8 = Merge(Data1=flatten(line_4), Data2=flatten(move_3.Geometry))
lng_4 = ListLength(List=line_4)

# ---- group: Egress nodes
move_4 = Move(Geometry=flatten(item_7), Motion=unit_z)  # -> Geometry, Transform
data_5 = Data([item_7, move_4.Geometry])
area_6 = Area(Geometry=move_4.Geometry)  # -> Area, Centroid
area_7 = Area(Geometry=data_5)  # -> Area, Centroid

# ---- group: Corridor nodes
move_5 = Move(Geometry=flatten(data_3), Motion=unit_z)  # -> Geometry, Transform

# ---- group: Room Edges
move_6 = Move(Geometry=flatten(data_4), Motion=unit_z)  # -> Geometry, Transform

# ---- group: Room Nodes
move_7 = Move(Geometry=flatten(cull_i_2), Motion=unit_z)  # -> Geometry, Transform

# ---- group: Cooridor Edges
move_8 = Move(Geometry=flatten(weave), Motion=unit_z)  # -> Geometry, Transform

# ---- group: Egress Nodes Per Level
partition = PartitionList(List=merge_7, Size=lng_3)  # -> simplify(Chunks)

# ---- group: Egress Edges Per Level
partition_2 = PartitionList(List=merge_8, Size=lng_4)  # -> simplify(Chunks)

# ----
data_6 = Data(flatten(weave))

merge_9 = Merge(Data1=data_3, Data2=flatten(move_5.Geometry))
merge_10 = Merge(Data1=data_4, Data2=flatten(move_6.Geometry))
merge_11 = Merge(Data1=flatten(cull_i_2), Data2=flatten(move_7.Geometry))
merge_12 = Merge(Data1=flatten(weave), Data2=flatten(move_8.Geometry))
lng_5 = ListLength(List=data_3)
lng_6 = ListLength(List=data_4)
lng_7 = ListLength(List=cull_i_2)
lng_8 = ListLength(List=weave)

# ---- group: Room Nodes Per Level
partition_3 = PartitionList(List=merge_11, Size=lng_7)  # -> simplify(Chunks)

# ---- group: Corridor Edges Per Level
partition_4 = PartitionList(List=merge_12, Size=lng_8)  # -> simplify(Chunks)

# ---- group: Corridor Nodes Per Level
partition_5 = PartitionList(List=merge_9, Size=lng_5)

# ---- group: Room Edges Per Level
partition_6 = PartitionList(List=merge_10, Size=lng_6)

# ----
data_7 = Data([data_4, move_6.Geometry])
data_8 = Data([data_6, move_8.Geometry])
midpt_2 = CurveMiddle(Curve=partition_4)
cullpt_2 = CullDuplicates(Points=midpt_2, Tolerance=0.1, CullMode=3)  # -> Points, Indices, Valence
line_sdl = LineSDL(Start=area_6.Centroid, Direction=Vector(0, 0, 1), Length=negative)
item_8 = ListItem(List=partition_4, Index=cullpt_2.Indices, Wrap=True)

# ---- group: All Edges Connecting Egress Nodes
crv_11 = Curve(flatten([partition_2, line_sdl]))

# ---- group: Corridor Weight
length = Length(Curve=item_8)

# ----
data_9 = Data([data_8, data_7, line_sdl, partition_2])
midpt_3 = CurveMiddle(Curve=flatten(data_9))
cullpt_3 = CullDuplicates(Points=midpt_3, Tolerance=0.1, CullMode=3)  # -> Points, Indices, Valence
item_9 = ListItem(List=flatten(data_9), Index=cullpt_3.Indices, Wrap=True)  # -> flatten(Item)
pt_4 = Point(partition)
list_length = ListLength(List=flatten(partition_3))
list_length_2 = ListLength(List=flatten(partition))
list_length_3 = ListLength(List=flatten(partition_5))
duplicate_data = DuplicateData(Data="UNIT", Number=list_length, Order=True)
duplicate_data_2 = DuplicateData(Data="EGRESS", Number=list_length_2, Order=True)
duplicate_data_3 = DuplicateData(Data="CORRIDOR", Number=list_length_3, Order=True)
merge_13 = Merge(Data1=flatten(partition_3), Data2=flatten(partition), Data3=flatten(partition_5))
collision_one_many = CollisionOneMany(Collider=flatten(item_9), Obstacles=graft(merge_13))  # -> Collision, Index
point_list_2 = PointList(Points=merge_13)

# ---- group: Node Names / Labels
merge_14 = Merge(Data1=duplicate_data, Data2=duplicate_data_2, Data3=duplicate_data_3)

# ----
item_index = ItemIndex(List=merge_13, Item=merge_13)
mass_addition = MassAddition(Input=collision_one_many.Collision)  # -> flatten(Result), PartialResults
deconstruct = Deconstruct(Point=merge_13)  # -> XComponent, YComponent, ZComponent
panel_8 = Panel(mass_addition.Result)

# ---- group: LIST LENGHT FOR EACH EDGE CATEGORY
merge_15 = Merge(Data1=list_length, Data2=list_length_2, Data3=list_length_3)

# ----
# Gathering Lines for Revit Walls, sorting around building to pair and find wall line
# between and determing which type of wall, demising or fire rated, based on if unit to
# unit or unit to egress
lng_9 = ListLength(List=partition_3)
lng_10 = ListLength(List=partition)
partition_7 = PartitionList(List=duplicate_data, Size=flatten(lng_9))  # -> simplify(Chunks)
partition_8 = PartitionList(List=duplicate_data_2, Size=flatten(lng_10))  # -> simplify(Chunks)
weave_2 = Weave(Pattern=[0, 1], Stream0=partition_3, Stream1=partition_7, NullGaps=False)
weave_3 = Weave(Pattern=[0, 1], Stream0=partition, Stream1=partition_8, NullGaps=False)
boundary = BoundarySurfaces(Edges=[crv_3, crv_9])
Z_2 = UnitZ(Factor="-0.5")
partition_9 = PartitionList(List=weave_2, Size="2")
partition_10 = PartitionList(List=weave_3, Size="2")
multiplication = Multiplication(A=subtraction_2, B="5")
move_9 = Move(Geometry=boundary, Motion=Z_2)  # -> Geometry, Transform
crv_12 = Curve(crv_9)
Z_3 = UnitZ(Factor=multiplication)
tstat = TreeStatistics(Tree=partition_10)  # -> Paths, Length, Count
series_3 = Series(Start=lng_9, Step=1, Count=lng_10)
extr = Extrude(Base=move_9.Geometry, Direction=Z_3)
dpath = DeconstructPath(Branch=tstat.Paths)
len_4 = Length(Curve=crv_12)
replace = ReplaceItems(List=dpath, Item=graft(series_3), Indices="1", Wrap=False)
path_3 = ConstructPath(Indices=replace)  # -> simplify(Branch)
dup = DuplicateData(Data=path_3, Number="2", Order=True)
tree = CreateTree(Data=partition_10, Path=dup)
merge_16 = Merge(Data1=partition_9, Data2=tree)
partition_11 = PartitionList(List=merge_16, Size="2")
item_10 = ListItem(List=partition_11, Index=0, Wrap=True)
item_11 = ListItem(List=partition_11, Index="1", Wrap=True)
pt_5 = Point(item_10)
graft = GraftTree(Tree=crv_12, IncludeEmptyLists=True, IncludeNullItems=True)
brepinc = PointInBrep(Brep=graft(extr), Point=item_10, Strict=False)
dispatch_8 = Dispatch(List=item_10, DispatchPattern=brepinc)  # -> ListA, ListB
dispatch_9 = Dispatch(List=item_11, DispatchPattern=brepinc)  # -> ListA, ListB
item_12 = ListItem(List=crv_12, Index="-1", Wrap=True)
item_13 = ListItem(List=crv_12, Index=0, Wrap=True)
txt_2 = Text(dispatch_9.ListB)
pt_6 = Point(dispatch_8.ListA)
shift = ShiftPaths(Data=pt_6, Offset="-2")
pt_7 = Point(dispatch_8.ListB)
txt_3 = Text(dispatch_9.ListA)
shift_2 = ShiftPaths(Data=pt_7, Offset="-2")
shift_3 = ShiftPaths(Data=txt_2, Offset="-2")
shift_4 = ShiftPaths(Data=txt_3, Offset="-2")

# ---- group: Room Nodes
point_7 = Point(flatten(partition_3))

# ---- group: Corridor Nodes
point_8 = Point(flatten(partition_5))

# ----
line_5 = Line(crv_11)

# ---- group: Egress Edge Weights
len_5 = Length(Curve=flatten(crv_11))

len_6 = Length(Curve=flatten(crv_11))

# ---- group: Corridor Weight
num = Number(flatten(length))

num_2 = Number(flatten(length))

# ----
# Points/Nodes and Room Use/Label
# Sorted Per Level Counter Clockwise
alongcrv_2 = SortAlongCurve(Points=shift, Curve=item_13)  # -> simplify(Points), Indices
alongcrv_3 = SortAlongCurve(Points=shift_2, Curve=item_12)  # -> simplify(Points), Indices
pt_8 = Point(alongcrv_3.Points)
pt_9 = Point(alongcrv_2.Points)
branch_2 = TreeBranch(Tree=alongcrv_3.Points, Path="3", MaintainPaths=True)
item_14 = ListItem(List=shift_3, Index=alongcrv_3.Indices, Wrap=True)
item_15 = ListItem(List=shift_4, Index=alongcrv_2.Indices, Wrap=True)
points_2 = PointList(Points=branch_2, Size=Slider(3.19, range=0.5..5))

lng_11 = ListLength(List=len_6)
lng_12 = ListLength(List=len_5)
merge_17 = Merge(Data1=simplify(graft(item_index)), Data2=simplify(graft(merge_14)), Data3=simplify(graft(mass_addition.Result)))
panel_9 = Panel(merge_17)
suirify = Suirify(deconstruct.XComponent)
suirify_2 = Suirify(deconstruct.YComponent)
suirify_3 = Suirify(deconstruct.ZComponent)
suirify_4 = Suirify(mass_addition.Result)

partition_12 = PartitionList(List=item_index, Size=merge_15)
bang_10 = ExplodeTree(Data=simplify(partition_12))  # -> Branch0, Branch1, Branch2
cp_3 = ClosestPoint(Point=point_7, Cloud=point_8)  # -> ClosestPoint, CPIndex, Distance
ln_6 = Line(StartPoint=point_7, EndPoint=cp_3.ClosestPoint)

# ---- group: Corridor Node ID
data_10 = Data(bang_10.Branch2)

# ---- group: Room Node ID
data_11 = Data(bang_10.Branch0)

# ----
item_16 = ListItem(List=data_10, Index=cp_3.CPIndex, Wrap=True)

merge_18 = Merge(Data1=flatten(ln_6), Data2=flatten(line_5), Data3=flatten(item_8))
end_4 = EndPoints(Curve=merge_18)  # -> Start, End
entwine = Entwine(Branch00=end_4.Start, Branch01=end_4.End, FlattenInputs=True)
pdecon_2 = Deconstruct(Point=merge_13)  # -> XComponent, YComponent, ZComponent
flip_2 = FlipMatrix(Data=entwine)  # -> simplify(Data)
pdecon_3 = Deconstruct(Point=flip_2)  # -> XComponent, YComponent, ZComponent
python_2 = GhPythonScript(
    vx=pdecon_3.XComponent,
    vy=pdecon_3.YComponent,
    vz=pdecon_3.ZComponent,
    x=pdecon_2.XComponent,
    y=pdecon_2.YComponent,
    z=pdecon_2.ZComponent)  # -> out, simplify(edge_verticies); inputs vx: tree, vy: tree, vz: tree, x: list, y: list, z: list
# ---------- python_2: Python ----------
import rhinoscriptsyntax as rs
#import Rhino.Geometry as rg
import ghpythonlib.treehelpers as th
#import Rhino.RhinoMath as rm

vx=th.tree_to_list(vx,None)
vy=th.tree_to_list(vy,None)
vz=th.tree_to_list(vz,None)

epsilon=0.0000000001

def epsilon_equals(value1, value2, epsilon):
    return abs(value1 - value2) < epsilon

edge_verticies=[]
for i in range(len(vx)):
    for j in range(len(x)):
        if epsilon_equals(vx[i][0],x[j],epsilon) and epsilon_equals(vy[i][0],y[j],epsilon) and epsilon_equals(vz[i][0],z[j],epsilon):
            first_node=j
        else:
            pass
        if epsilon_equals(vx[i][1],x[j],epsilon) and epsilon_equals(vy[i][1],y[j],epsilon) and epsilon_equals(vz[i][1],z[j],epsilon):
            second_node=j
        else:
            pass
    edge_verticies.append([first_node,second_node])
    
edge_verticies=th.list_to_tree(edge_verticies)
# ---------- end python_2 ----------
panel_10 = Panel(pdecon_3.XComponent)

python_3 = GhPythonScript(
    vx=pdecon_3.XComponent,
    vy=pdecon_3.YComponent,
    vz=pdecon_3.ZComponent,
    x=pdecon_2.XComponent,
    y=pdecon_2.YComponent,
    z=pdecon_2.ZComponent)  # -> out, simplify(edge_verticies); inputs vx: tree, vy: tree, vz: tree, x: list, y: list, z: list; disabled
# ---------- python_3: Python ----------
import rhinoscriptsyntax as rs
import Rhino.Geometry as rg
import ghpythonlib.treehelpers as th
import Rhino.RhinoMath as rm

vx=th.tree_to_list(vx,None)
vy=th.tree_to_list(vy,None)
vz=th.tree_to_list(vz,None)

epsilon=0.0000000001
edge_verticies=[]
for i in range(len(vx)):
    for j in range(len(x)):
        if rm.EpsilonEquals(vx[i][0],x[j],epsilon) and rm.EpsilonEquals(vy[i][0],y[j],epsilon) and rm.EpsilonEquals(vz[i][0],z[j],epsilon):
            first_node=j
        else:
            pass
        if rm.EpsilonEquals(vx[i][1],x[j],epsilon) and rm.EpsilonEquals(vy[i][1],y[j],epsilon) and rm.EpsilonEquals(vz[i][1],z[j],epsilon):
            second_node=j
        else:
            pass
    edge_verticies.append([first_node,second_node])
    
edge_verticies=th.list_to_tree(edge_verticies)
# ---------- end python_3 ----------
panel_11 = Panel(python_2.edge_verticies)

# ---- group: Room To Corridor Edge Length / Weight
len_7 = Length(Curve=ln_6)

len_8 = Length(Curve=ln_6)

# ---- group: Weights
merge_19 = Merge(Data1=flatten(len_8), Data2=flatten(len_5), Data3=flatten(num_2))  # -> simplify(graft(Result))

merge_20 = Merge(Data1=flatten(len_7), Data2=flatten(len_6), Data3=flatten(num))

# ----
lng_13 = ListLength(List=merge_20)
lng_14 = ListLength(List=merge_19)
total_weights = Panel(lng_13)
data_12 = Data(flatten(merge_19))
suirify_5 = Suirify(data_12)

# ----
# OUTPUT
python_4 = GhPythonScript(
    x=flatten(suirify),
    y=flatten(suirify_2),
    z=flatten(suirify_3),
    nodeDegree=flatten(suirify_4),
    v=python_2.edge_verticies,
    edgeFeatures=flatten(suirify_5))  # -> out, output, flatten(json_string); inputs x: list, y: list, z: list, nodeDegree: list, v: tree, edgeFeatures: list
# ---------- python_4: Python ----------
__author__ = "REN"
__version__ = "2023.08.19"

import rhinoscriptsyntax as rs
import ghpythonlib.treehelpers as th
import json

data_dict = {}
edge_dict = {}
node_dict = {}
edge_array = []
node_array = []

#if not isinstance(v, list):  # replace type_expected_for_tree with the expected type
#    print("v is not a tree!")
#else:
v = th.tree_to_list(v, None)
# edgeFeatures = th.tree_to_list(edgeFeatures, None)
c = 0

for i in range(len(v)):
    edge_dict = {
        "edge": {
            "type": "object",
            "additionalProperties": False,
            "properties": {
                "id": c,
                "source": v[i][0],
                "target": v[i][1],
                "metadata": {
                    "length": edgeFeatures[i]
                }
            }
        }
    }
    edge_array.append(edge_dict)
    c+=1

c = 0
for i in range(len(x)):
    node_dict = {
        "node": {
            "type": "object",
            "properties": {
                "label": c,
                "degree": nodeDegree[i],
                "metadata": {
                    "type": "Feature",
                    "geometry": {
                        "type": "Point",
                        "coordinates": [x[i], y[i], z[i]]
                    }
                }
            }
        }
    }
    node_array.append(node_dict)
    c+=1

data_dict = {"title": "Graph Start",
"type": "FeatureCollection",
"features": node_array + edge_array
}

output = str(data_dict)
json_string = json.dumps(data_dict)
# ---------- end python_4 ----------

data_13 = Data(python_4.json_string)
writetxt = WriteToTextFile(Run=Toggle(False), TextToWrite=data_13, FilePath=path_2, Append=False, NewOnly=False)

# ---- group: RH_OUT:output
data_14 = Data(python_4.json_string)
